# Grasshopper definition 9_ML_Inference.ghx (Grasshopper 1.0.8)
# plug-ins: Eddy3D

# ---- group: wind direction
list = ValueList({"North": 0, "Northeast": 45, "East": 90, "Southeast": 135, "South": 180, "Southwest": 225, "West": 270, "Northwest": 315}, selected="West")

# ---- group: Wind Speed
panel = Panel("5")

# ----
swatch = ColourSwatch(SwatchColor=RGB(0, 0, 0))
abl = ABLFlow(WindDirections=list, ReferenceVelocity=panel)
compass = WindCompass(DirectionIndex=list, Radius=420, BasePoint=Point(0, 0, 0), Color=swatch, ArrowScale=0.5)  # -> Circle, Arrow

# ---- group: Legend Settings
dom = ConstructDomain(DomainStart=0, DomainEnd=panel)

# ----
list_2 = ValueList({"Velocity": 0, "Turbulent Kinetic Energy": 1}, selected="Velocity")
entwine = Entwine(Branch00=dom, FlattenInputs=True)  # -> simplify(Result)
branch = TreeBranch(Tree=entwine, Path=list_2, MaintainPaths=True)

model = ValueList({"Yel": 0, "Esen": 1, "Poyraz": 2}, selected="Yel")
token = FilePath("C:\Users\ilker\Desktop\Conditional_Transformer\TokenHF\HF_Token.txt")
mlmodel = MLModel(Run=True, Model=model, HFToken=token)  # -> Status, FilePath, Progress

# ---- group: Terrain- Do not change, try to center your geometry accordingly. / TERRAIN
srf = Surface(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)

# ---- group: Terrain- Do not change, try to center your geometry accordingly.
move = Move(Geometry=srf, Motion=Vector(0, 0, 1.8))  # -> Geometry, Transform
brep2grid = BrepToGridPoints(Geometry=move.Geometry, Spacing="2", Run=True)  # -> Points, Status

# ---- group: Geometry Input
list_3 = ValueList({"Architectural Insitute of Japan - Case E": 0, "OpenFOAM - Wind Around Buildings": 1, "Eddy3D Validation Sample": 2}, selected="Architectural Insitute of Japan - Case E")
brep = Brep([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])
brep_2 = Brep([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])
brep_3 = Brep([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])
entwine_2 = Entwine(Branch00=brep, Branch01=brep_2, Branch02=brep_3, FlattenInputs=True)  # -> simplify(Result)
branch_2 = TreeBranch(Tree=entwine_2, Path=list_3, MaintainPaths=True)

# ---- group: Geometry Input / Buildings
brep_4 = Brep(branch_2)

# ---- group: Geometry Input (continued)
preview = CustomPreview(Geometry=brep_4, Material=ColourSwatch(SwatchColor=RGB(204, 204, 204)))

# ----
windpredict = WindPredictor(
    Points=brep2grid.Points,
    Buildings=brep_4,
    Model=mlmodel.FilePath,
    BoundaryConditions=abl,
    Pedestrian_level=1.8,
    FilterMargin=100,
    Palette=0,
    LegendDomain=branch,
    Field=list_2,
    Level=1)  # -> X, Y, Values, GridMesh, LegendMesh, LegendPoints, LegendValues, BoundaryConditions, ValuesRoof

bnd = Bounds(Numbers=windpredict.Values)
mesh = Mesh(windpredict.GridMesh)
mesh_2 = Mesh(windpredict.LegendMesh)
tag = TextTag3D(Location=windpredict.LegendPoints, Text=windpredict.LegendValues, Size=14, Colour=swatch, Justification=5)
area = Area(Geometry=mesh_2)  # -> Area, Centroid
Y = UnitY(Factor=-100)
Y_2 = UnitY(Factor=-50)
move_2 = Move(Geometry=area.Centroid, Motion=Y)  # -> Geometry, Transform
move_3 = Move(Geometry=move_2.Geometry, Motion=Y_2)  # -> Geometry, Transform
concat = Concatenate(
    FragmentA="Incoming wind direction & speed: ",
    FragmentB=compass.Arrow,
    FragmentC=", ",
    FragmentD=panel,
    FragmentE=" m/s")
tag_2 = TextTag3D(Location=move_3.Geometry, Text=concat, Size=16, Colour=swatch, Justification=5)

# ---- group: Wind speed range
panel_2 = Panel(bnd)

# ----
concat_2 = Concatenate(FragmentA="Min - Max: ", FragmentB=panel_2)
tag_3 = TextTag3D(Location=move_2.Geometry, Text=concat_2, Size=16, Colour=swatch, Justification=5)
