# Grasshopper definition CylinderDomain.ghx (Grasshopper 1.0.8)
# plug-ins: Outdoor

series = Series(Start="0", Step="45", Count="8")

# ---- group: Tree
geometry = Geometry(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)
tree = Tree(Geometry=geometry, Type="medium")

# ----
cylinder_domain = CylinderDomain(
    CoreCellSize="30",
    InnerCoreSize=-1,
    OuterRadius=-1,
    Height=-1,
    RadialMultiplier=2,
    CoreDivisions=1,
    RefinementBoxExtension=-1,
    RadialGrading=7,
    CoreRoundness=0.65,
    VerticalGrading=35)
atmospheric_boundary_layer = AtmosphericBoundaryLayer(
    WindDirections=series,
    WindSpeed="5",
    ReferenceHeight=10,
    RoughnessLengthZ0=1,
    GroundHeight=0,
    TurbulentKEK=0.015,
    TurbulentEpsilonΕ=0.135,
    TurbulentOmegaΩ=100)  # -> BoundaryConditions, WindVectors, AirABLSettings
run_settings = RunSettings(
    Iterations="200",
    WriteInterval=20,
    KeepTimeSteps=3,
    TurbulenceModel="realizableKE",
    CPUCount=-1,
    SolverAlgorithm="SIMPLE",
    AgeOfAir=False,
    Robustness="4",
    PotentialFoamInit=True,
    WarmUpIterations=-1,
    FieldMonitors=False,
    PedestrianAverage=False,
    PressureCoefficient=False,
    Convergence=0.0001,
    AutoStopOnPlateau=False)  # -> RunSettings, DebugLogs

# ---- group: Buildings
geometry_2 = Geometry([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])

# ----
outdoor_case = OutdoorCase(
    CaseName="CylinderDomain",
    BoundaryConditions=atmospheric_boundary_layer.BoundaryConditions,
    DomainParameters=cylinder_domain,
    Buildings=geometry_2,
    Trees=tree,
    RunSettings=run_settings.RunSettings,
    Write=False,
    ClearCase=False,
    AutoName="merry-lemur-dune-quill",
    OutdoorCaseInputLayoutVersion=2,
    PreviewBuildings=False,
    PreviewDimensions=True,
    PreviewGrid3D=True,
    PreviewGroundGrid=True,
    PreviewRefinementBox=True,
    PreviewWindArrows=True)  # -> Logs, WriteLogs, Case, Domain, RefinementBox, Buildings
meshing_progress = MeshingProgress(Case=outdoor_case.Case, Live=True)  # -> Progress, Phase, Done, Status

debrep = DeconstructBrep(Brep=outdoor_case.RefinementBox)  # -> Faces, Edges, Vertices
item = ListItem(List=debrep.Faces, Index=4, Wrap=True)
area = Area(Geometry=item)  # -> Area, Centroid
Z = UnitZ(Factor=Slider(2, range=0..10))
scale = Scale(Geometry=item, Center=area.Centroid, Factor=3)  # -> Geometry, Transform
move = Move(Geometry=scale.Geometry, Motion=Z)  # -> Geometry, Transform
brep_grid_points = BrepGridPoints(Geometry=move.Geometry, Spacing=10)  # -> Points, Vectors, Mesh, Status

plot_residuals = PlotResiduals(Case=outdoor_case.Case, Plot=False, ResidualViewerTarget=0)
live_residuals = LiveResiduals(Case=outdoor_case.Case, Live=True, DirectionDegrees=-1)
run = Run(
    Case=outdoor_case.Case,
    Mesh=Button(),
    CreateZones=Button(),
    Simulate=Button(),
    RunAll=False,
    Parallel=True,
    DirectionIndex=-1,
    ShowZones=True)

probe = Probe(
    Case=outdoor_case.Case,
    Points=brep_grid_points.Points,
    Field="U",
    Run=False,
    AutoProbeName="sunny-ferret-mesa-compass",
    BakeTimeHistory=False,
    CullHugeVectors=True,
    CullInvalid=True,
    ShowRegion=False)  # -> Values, TimeSteps, SubResults
cluster = Cluster(data=probe.Values)  # -> S, E, data_3
amp = Amplitude(Vector=probe.Values, Amplitude=4)
gradient = Gradient(
    LowerLimit=cluster.S,
    UpperLimit=cluster.E,
    Parameter=cluster.data_3,
    stops=[0.103: RGB(0, 0, 255), 0.22: RGB(0, 170, 255), 0.305: RGB(0, 255, 255), 0.398: RGB(0, 255, 188), 0.504: RGB(0, 255, 106), 0.605: RGB(91, 255, 0), 0.699: RGB(184, 255, 0), 0.799: RGB(255, 255, 0), 0.898: RGB(255, 170, 0)])
vdisex = VectorDisplayEx(Point=brep_grid_points.Points, Vector=amp, Colour=gradient, Width=Slider(3, range=0..10))

download_weather = DownloadWeather(Search="Atlanta")  # -> EPWFile, Logs, Stations
open_in_paraview = OpenInParaView(
    Case=outdoor_case.Case,
    Open=False,
    BoundaryConditions=atmospheric_boundary_layer.BoundaryConditions,
    EPWPath=download_weather.EPWFile,
    ComfortMetric=1,
    DirectionIndex=-1)
velocity_amplification_factors_vaf = VelocityAmplificationFactorsVAF(
    BoundaryConditions=atmospheric_boundary_layer.BoundaryConditions,
    WindVelocity=probe.Values,
    EPW=download_weather.EPWFile,
    ProbeHeight=1.8,
    Interpolate=True,
    Points=brep_grid_points.Points)  # -> WindSpeed, VelocityAmplificationFactors
pedestrian_wind_comfort = PedestrianWindComfort(
    WindSpeed=velocity_amplification_factors_vaf.WindSpeed,
    ComfortMetric="Lawson General",
    ColorScheme="Classic",
    Size=Slider(5, range=0..10))  # -> ComfortRank, ClassLetter, ComfortClass, Mesh, Colors, LegendColors, LegendLabels
mesh = Mesh(pedestrian_wind_comfort.Mesh)

# ==== cluster Cluster
data = ClusterInput()
data_2 = Data(data)
data_3 = ClusterOutput(data_2)
bnd = Bounds(Numbers=data_2)
dedomain = DeconstructDomain(Domain=bnd)  # -> Start, End
S = ClusterOutput(dedomain.Start)
E = ClusterOutput(dedomain.End)
